# Grasshopper definition flockingTest.gh (Grasshopper 0.9.75)
# plug-ins: Agent

number_slider = Slider(10000, range=0..10000)
planesrf = PlaneSurface(Plane=PlaneXY(0, 0, 0), XSize=Domain(-10, 10), YSize=Domain(-10, 10))
number_slider_2 = Slider(4, range=0..10)
wires = BrepWireframe(Brep=planesrf, Density=-1)
particle = ConstructParticle(
    MinimumInitialVelocity=Vector(-0.1, -0.1, -0.1),
    MaximumInitialVelocity=Vector(0.1, 0.1, 0.1),
    Acceleration=Vector(0, 0, 0),
    Lifespan=Slider(-1, range=-1..1000),
    Mass=1,
    BodySize=1,
    HistoryLength=1)
join = JoinCurves(Curves=wires, Preserve=False)
agent = ConstructAgent(Particle=particle, MaxSpeed=0.5, MaxForce=0.1, VisionRadius=5, VisionAngle=360)
ptemit = PointEmitter(ContinuousFlow=Toggle(False), CreationRate=1, NumberOfQuelea=Slider(1, range=0..1000), Point=Point(0, 0, 0))
srfenv = SurfaceEnvironment(Surface=planesrf)  # -> Environment, _2DReferenceSurface
number_slider_3 = Slider(0.333, range=0..1)  # disabled
system = System(Quelea=agent, Emitters=ptemit, Environment=srfenv.Environment)  # -> System, Quelea, QueleaNetwork
followpath = FollowPathForce(
    Apply=True,
    Agent=system.Quelea,
    WeightMultiplier=1,
    Curve=join,
    PathRadius=Slider(1.5, range=0..10),
    PredictionDistance=number_slider_2,
    PathTargetDistance=number_slider_2)  # -> Force, PredictionLocation, PathPoint
timer = Timer(TimerInterval=20, Target=[engine, system])  # disabled
contain = ContainForce(Apply=True, Agent=system.Quelea, WeightMultiplier=1, Environment=srfenv.Environment, VisionRadiusMutliplier=0.2)  # disabled
number_slider_4 = Slider(0.2, range=0..1)  # disabled
engine = Engine(Reset=Toggle(True), System=system.System)
neighbors = GetNeighborsInRadius(Agent=system.Quelea, QueleaNetwork=system.QueleaNetwork, VisionRadiusMultiplier=1, VisionAngleMultiplier=1)  # disabled
neighbors_2 = GetNeighborsInRadius(Agent=system.Quelea, QueleaNetwork=system.QueleaNetwork, VisionRadiusMultiplier=number_slider_3, VisionAngleMultiplier=1)  # disabled
departicle = DeconstructParticle(Particle=system.Quelea)  # -> Position, Velocity, Acceleration, Lifespan, Mass, BodySize, SurfacePosition, SurfaceVelocity, SurfaceAcceleration
item = ListItem(List=departicle.Position, Index=0, Wrap=True)  # -> flatten(Item)
pt = Point(departicle.SurfacePosition)
separate = SeparateForce(Apply=True, Agent=system.Quelea, WeightMultiplier=number_slider_4, GetNeighborsInRadius=neighbors_2)  # disabled
cohese = CoheseForce(Apply=True, Agent=system.Quelea, WeightMultiplier=1, GetNeighborsInRadius=neighbors)  # disabled
vdis = VectorDisplay(Anchor=item, Vector=departicle.Velocity)
vdis_2 = VectorDisplay(Anchor=pt, Vector=departicle.SurfaceVelocity)
vdis_3 = VectorDisplay(Anchor=pt, Vector=followpath.Force)
